# Grasshopper definition Fingerless Glove Sizing System Visualization.gh (Grasshopper 1.0.8)

# Transform Mesh to Brep
mesh = Mesh(<mesh referenced from the Rhino model>)

# ----
# Avambraccio
# Order
# Seam Allignment
# Direction Allignment
number_slider = Slider(10000, range=0..10000)
qrsettings = QuadRemeshSettings(TargetCount=number_slider, AdaptiveSize=0, AdaptiveCount=False, HardEdges=False, SeamEdges=0, Symmetry=0, GuideCurves=0)
qrmesh = QuadRemesh(Geometry=mesh, Settings=qrsettings)
subdmesh = SubDFromMesh(Mesh=qrmesh, Creases=2, Corners=2, Interpolate=False)
subd = SubD(subdmesh)

brep = Brep(subd)

# ----
# SubD Slicing
Z = UnitZ(Factor=1)
contour = Contour(Shape=brep, Point=Point(0, 0, 0), Direction=Z, Distance=Slider(3, range=0..10))

flatten = FlattenTree(Tree=contour, Path="{0}")
panel = Panel(flatten)

# ----
# Arm and hand circunferences based scaling
# Hand_Circumference
# Forearm_Circumference
topoly = CurveToPolyline(Curve=flatten, ToleranceDistance=0, ToleranceAngle=0)  # -> Polyline, Segments
flatten_2 = FlattenTree(Tree=flatten, Path="{0}")
flatten_3 = FlattenTree(Tree=flatten, Path="{0}")
# Rebuild Curves
# Avambraccio_Senza Rebuild
# Order
# Seam Allignment
# Direction Allignment
number_slider_2 = Slider(13, range=0..183)
flatten_4 = FlattenTree(Tree=topoly.Polyline, Path="{0}")
item = ListItem(List=flatten_2, Index=number_slider_2, Wrap=True)
item_2 = ListItem(List=flatten_3, Index=Slider(83, range=0..183), Wrap=True)
area = Area(Geometry=flatten_4)  # -> Area, Centroid
crv = Curve(item_2)
crv_2 = Curve(item)
area_2 = Area(Geometry=crv_2)  # -> Area, Centroid
area_3 = Area(Geometry=crv)  # -> Area, Centroid
pdecon = Deconstruct(Point=area.Centroid)  # -> XComponent, YComponent, ZComponent
flatten_5 = FlattenTree(Tree=area.Centroid, Path="{0}")
# Palmo 1_Senza Rebuild
# Order
# Seam Allignment
# Direction Allignment
pt = Point(area_2.Centroid)
pt_2 = Point(area_3.Centroid)
sort = SortList(Keys=pdecon.ZComponent, ValuesA=flatten_5)  # -> Keys, ValuesA
pl = ConstructPlane(Origin=area_3.Centroid, XAxis=Vector(1, 0, 0), YAxis=Vector(0, 1, 0))
sort_2 = SortList(Keys=pdecon.ZComponent, ValuesA=flatten_4)  # -> Keys, ValuesA
panel_2 = Panel(sort.ValuesA)
pdecon_2 = Deconstruct(Point=pt_2)  # -> XComponent, YComponent, ZComponent
pdecon_3 = Deconstruct(Point=pt)  # -> XComponent, YComponent, ZComponent
expression = Expression(x=pdecon.ZComponent, y=pdecon_3.ZComponent, z=pdecon_2.ZComponent, Expression="min( max( (x - y) / (z - y), 0 ), 1 )")

len = Length(Curve=crv_2)
division = Division(A=Slider(305, range=200..400), B=len)

len_2 = Length(Curve=crv)
division_2 = Division(A=Slider(227, range=160..280), B=len_2)

expression_2 = Expression(x=expression, y=division, z=division_2, Expression="if(x > 1, z, (1 - x) * y + x * z)")
panel_3 = Panel(expression_2)
scale_nu = ScaleNU(Geometry=sort_2.ValuesA, Plane=pl, ScaleX=expression_2, ScaleY=expression_2, ScaleZ=Slider(1, range=0..1))  # -> flatten(Geometry), Transform
