# Grasshopper definition Fingerless Glove Sizing System.gh (Grasshopper 1.0.8)
# plug-ins: Pufferfish

mesh = Mesh(<mesh referenced from the Rhino model>)

Z = UnitZ(Factor=1)
contour = Contour(Shape=mesh, Point=Point(0, 0, 0), Direction=Z, Distance=Slider(3, range=0..10))
area = Area(Geometry=contour)  # -> Area, Centroid
pdecon = Deconstruct(Point=area.Centroid)  # -> XComponent, YComponent, ZComponent
sort = SortList(Keys=pdecon.ZComponent, ValuesA=area.Centroid)  # -> Keys, ValuesA
lng = ListLength(List=flatten(sort.ValuesA))
panel = Panel(lng)

# ----
# Finger Excess
panel_2 = Panel("""95
118
141
146
147""")
panel_3 = Panel("""86
102
117
123
124""")
item = ListItem(List=flatten(sort.ValuesA), Index=panel_3, Wrap=True)
item_2 = ListItem(List=flatten(sort.ValuesA), Index=panel_2, Wrap=True)
vec2pt = Vector2Pt(PointA=item, PointB=item_2, Unitize=False)  # -> Vector, Length
panel_4 = Panel(vec2pt.Vector)
vdis = VectorDisplay(Anchor=item, Vector=vec2pt.Vector)
circle = CircleCNR(Center=item, Normal=vec2pt.Vector, Radius=Slider(15, range=0..20))
boundary = BoundarySurfaces(Edges=circle)
msplit = MeshSplit(Mesh=mesh, Splitters=boundary)
dispatch = Dispatch(List=msplit, DispatchPattern=boundary)  # -> ListA, ListB

# ----
# Forearm Excess
number_slider = Slider(10, range=0..10)
# Avambraccio_Senza Rebuild
# Palmo 1_Senza Rebuild
# Order
# Order
# Seam Allignment
# Seam Allignment
# Direction Allignment
# Direction Allignment
number_slider_2 = Slider(25, range=0..25)
item_3 = ListItem(List=flatten(sort.ValuesA), Index=number_slider, Wrap=True)
item_4 = ListItem(List=flatten(sort.ValuesA), Index=number_slider_2, Wrap=True)
vec2pt_2 = Vector2Pt(PointA=item_3, PointB=item_4, Unitize=False)  # -> Vector, Length
vdis_2 = VectorDisplay(Anchor=item_3, Vector=vec2pt_2.Vector)
circle_2 = CircleCNR(Center=item_3, Normal=vec2pt_2.Vector, Radius=Slider(100, range=0..100))
boundary_2 = BoundarySurfaces(Edges=circle_2)

# ----
# Excess Parts Removal_Fingerless Mesh
msplit_2 = MeshSplit(Mesh=dispatch.ListA, Splitters=boundary_2)  # -> flatten(Result)
dispatch_2 = Dispatch(List=msplit_2, DispatchPattern=[True, False])  # -> ListA, ListB
item_5 = ListItem(List=dispatch_2.ListB, Index=0, Wrap=True)
item_6 = ListItem(List=dispatch_2.ListA, Index=0, Wrap=True)
msmooth = SmoothMesh(Mesh=item_5, Strength=Slider(1.5, range=0..5), SkipNaked=True, Iterations=1)

# ----
# Transform Mesh to Brep
number_slider_3 = Slider(10000, range=0..10000)
qrsettings = QuadRemeshSettings(
    TargetCount=number_slider_3,
    AdaptiveSize=0,
    AdaptiveCount=False,
    HardEdges=False,
    SeamEdges=0,
    Symmetry=0,
    GuideCurves=0)
qrmesh = QuadRemesh(Geometry=msmooth, Settings=qrsettings)
subdmesh = SubDFromMesh(Mesh=qrmesh, Creases=2, Corners=2, Interpolate=False)
subd = SubD(subdmesh)

# ----
# Sub D Contour
number_slider_4 = Slider(3, range=0..10)
Z_2 = UnitZ(Factor=1)
contour_2 = Contour(Shape=subd, Point=Point(0, 0, 0), Direction=Z_2, Distance=number_slider_4)

subdverts = SubDVertices(SubD=subd)  # -> Point, Id, Tag
flatten = FlattenTree(Tree=contour_2, Path="{0}")

# ----
# With Boolean Difference
# subtract the pattern from
# the fingerless glove.
# 
# Then trasform the Polysurface
# into a SubD for rendering
brep = Brep(<brep referenced from the Rhino model>)
mesh_2 = MeshBrep(
    Brep=brep,
    Settings={GridMaxCount=0, GridMinCount=16, JaggedSeams=False, MaxEdgeLength=0, MinEdgeLength=0.0001, MinTolerance=0, Refine=True, RefineAngle=0, RelativeTolerance=0.65, SimplePlanes=True, Tolerance=0})
# Seam Allignment
# Direction Allignment
# Rebuild Curves
# Order
# Order
# Order
# Seam Allignment
# Seam Allignment
# Seam Allignment
# Order
# Order
# Seam Allignment
# Direction Allignment
# Direction Allignment
# Seam Allignment
# Direction Allignment
# Rebuild Curves
# Rebuild Curves
# Rebuild Curves
# Direction Allignment
# Direction Allignment
# Rebuild Curves
# Rebuild Curves
subdmesh_2 = SubDFromMesh(Mesh=mesh_2, Creases=1, Corners=1, Interpolate=False)

# ----
# Mesh scaling based on Hand_Circumference and Forearm_Circumference
topoly = CurveToPolyline(Curve=flatten, ToleranceDistance=0, ToleranceAngle=0)  # -> graft(Polyline), Segments
cls = Closed(Curve=topoly.Polyline)  # -> Closed, Periodic
dispatch_3 = Dispatch(List=topoly.Polyline, DispatchPattern=cls.Closed)  # -> ListA, ListB
item_7 = ListItem(List=dispatch_3.ListB, Index=0, Wrap=True)
divide = DivideCurve(Curve=item_7, Count=10, Kinks=False)  # -> Points, Tangents, Parameters
pdecon_2 = Deconstruct(Point=divide.Points)  # -> XComponent, YComponent, ZComponent
item_8 = ListItem(List=dispatch_3.ListA, Index=0, Wrap=True)
avr = Average(Input=pdecon_2.ZComponent)
avr_2 = Average(Input=pdecon_2.YComponent)
avr_3 = Average(Input=pdecon_2.XComponent)
area_2 = Area(Geometry=item_8)  # -> Area, Centroid
pt = ConstructPoint(XCoordinate=avr_3, YCoordinate=avr_2, ZCoordinate=avr)
# Forearm_Circumference
flatten_2 = FlattenTree(Tree=flatten, Path="{0}")
# Hand_Circumference
flatten_3 = FlattenTree(Tree=flatten, Path="{0}")
item_9 = ListItem(List=flatten_2, Index=Slider(7, range=0..183), Wrap=True)
item_10 = ListItem(List=flatten_3, Index=Slider(66, range=0..183), Wrap=True)
weave = Weave(Pattern=cls.Closed, Stream0=pt, Stream1=area_2.Centroid, NullGaps=False)
crv = Curve(item_9)
crv_2 = Curve(item_10)
pdecon_3 = Deconstruct(Point=weave)  # -> XComponent, YComponent, ZComponent
area_3 = Area(Geometry=crv)  # -> Area, Centroid
area_4 = Area(Geometry=crv_2)  # -> Area, Centroid
pt_2 = Point(area_4.Centroid)
pt_3 = Point(area_3.Centroid)
sort_2 = SortList(Keys=pdecon_3.ZComponent, ValuesA=topoly.Polyline)  # -> Keys, ValuesA
pl = ConstructPlane(Origin=area_4.Centroid, XAxis=Vector(1, 0, 0), YAxis=Vector(0, 1, 0))
panel_5 = Panel(sort_2.ValuesA)
pdecon_4 = Deconstruct(Point=pt_2)  # -> XComponent, YComponent, ZComponent
pdecon_5 = Deconstruct(Point=pt_3)  # -> XComponent, YComponent, ZComponent
pdecon_6 = Deconstruct(Point=subdverts.Point)  # -> XComponent, YComponent, ZComponent
c_script = CSharpScript(x=pdecon_6.ZComponent, y=pdecon_4.ZComponent, z=pdecon_5.ZComponent)  # -> out, result; inputs x: list of Double, y: Double, z: Double
# ---------- c_script: C# ----------
using System;
using System.Collections;
using System.Collections.Generic;
using System.Linq;
using Rhino;
using Rhino.Geometry;
using Rhino.DocObjects;
using Rhino.Collections;
using Grasshopper;
using Grasshopper.Kernel;
using Grasshopper.Kernel.Data;
using Grasshopper.Kernel.Types;

public class Script_Instance : GH_ScriptInstance
{
    #region Utility functions
    private void Print(string text) { /* implementation hidden */ }
    #endregion

    private void RunScript(List<double> x, double y, double z, ref object result)
    {
        List<double> output = new List<double>();
        
        for(int i = 0; i < x.Count; i++)
        {
            double value = Math.Min(Math.Max((x[i] - y) / (z - y), 0.0), 1.0);
            output.Add(value);
        }
        
        result = output;
    }
}
# ---------- end c_script ----------
panel_6 = Panel(c_script.result)

panel_7 = Panel(weave)

len = Length(Curve=crv)
division = Division(A=Slider(230, range=200..400), B=len)

len_2 = Length(Curve=crv_2)
division_2 = Division(A=Slider(190, range=160..280), B=len_2)

c_script_2 = CSharpScript(x=c_script.result, y=division_2, z=division)  # -> out, result; inputs x: list of Double, y: Double, z: Double
# ---------- c_script_2: C# ----------
using System;
using System.Collections;
using System.Collections.Generic;
using System.Linq;
using Rhino;
using Rhino.Geometry;
using Rhino.DocObjects;
using Rhino.Collections;
using Grasshopper;
using Grasshopper.Kernel;
using Grasshopper.Kernel.Data;
using Grasshopper.Kernel.Types;

public class Script_Instance : GH_ScriptInstance
{
    #region Utility functions
    private void Print(string text) { /* implementation hidden */ }
    #endregion

    private void RunScript(List<double> x, double y, double z, ref object result)
    {
        List<double> output = new List<double>();
        
        // Controllo input
        if(x == null)
        {
            Print("ERRORE: Input x è null");
            result = output;
            return;
        }
        
        Print("Input x count: " + x.Count);
        Print("Input y: " + y);
        Print("Input z: " + z);
        
        for(int i = 0; i < x.Count; i++)
        {
            double inputValue = x[i];
            double factor;
            
            if(inputValue > 1.0)
            {
                factor = z;
            }
            else
            {
                factor = (1.0 - inputValue) * y + inputValue * z;
            }
            
            output.Add(factor);
        }
        
        Print("Output count: " + output.Count);
        result = output;
    }
}
# ---------- end c_script_2 ----------
c_script_3 = CSharpScript(x=subd, y=c_script_2.result, z=pl)  # -> out, scaledGeometry; inputs x: Mesh, y: list of Double, z: Point3d
# ---------- c_script_3: C# ----------
using System;
using System.Collections;
using System.Collections.Generic;
using System.Linq;
using Rhino;
using Rhino.Geometry;
using Rhino.DocObjects;
using Rhino.Collections;
using Grasshopper;
using Grasshopper.Kernel;
using Grasshopper.Kernel.Data;
using Grasshopper.Kernel.Types;

public class Script_Instance : GH_ScriptInstance
{
    #region Utility functions
    private void Print(string text) { /* implementation hidden */ }
    #endregion

    private void RunScript(
		Mesh x,
		List<double> y,
		Point3d z,
		ref object scaledGeometry)
    {
        if(x == null || y == null)
        {
            Print("ERRORE: Input null");
            scaledGeometry = null;
            return;
        }
        
        Mesh newMesh = x.DuplicateMesh();
        Point3d[] vertices = newMesh.Vertices.ToPoint3dArray();
        
        Print("Vertici: " + vertices.Length);
        Print("Scale factors: " + y.Count);
        
        for(int i = 0; i < vertices.Length && i < y.Count; i++)
        {
            Point3d vertex = vertices[i];
            double scaleFactor = y[i];
            
            Vector3d toVertex = vertex - z;
            toVertex.X *= scaleFactor;
            toVertex.Y *= scaleFactor;
            
            vertices[i] = z + toVertex;
        }
        
        for(int i = 0; i < vertices.Length; i++)
        {
            newMesh.Vertices.SetVertex(i, vertices[i]);
        }
        
        newMesh.Normals.ComputeNormals();
        newMesh.Compact();
        
        scaledGeometry = newMesh;
    }
}
# ---------- end c_script_3 ----------

subd_2 = SubD(c_script_3.scaledGeometry)
mesh_3 = MeshBrep(
    Brep=subd_2,
    Settings={GridMaxCount=0, GridMinCount=16, JaggedSeams=False, MaxEdgeLength=0, MinEdgeLength=0.0001, MinTolerance=0, Refine=True, RefineAngle=0, RelativeTolerance=0.65, SimplePlanes=True, Tolerance=0})

# ----
# Map texture origin
number_slider_5 = Slider(802, range=0..1000)
medges = MeshEdges(Mesh=mesh_3)  # -> NakedEdges, InteriorEdges, NonManifoldEdges
popgeo = PopulateGeometry(Geometry=mesh_3, Count=number_slider_5, Seed=Slider(14, range=0..100))
crv_cp = CurveClosestPoint(Point=popgeo, Curve=medges.NakedEdges)  # -> Point, Parameter, Distance
bnd = Bounds(Numbers=crv_cp.Distance)
dom = ConstructDomain(DomainStart=Slider(2, range=0..10), DomainEnd=Slider(0.5, range=0..10))
remap = RemapNumbers(Value=crv_cp.Distance, Source=bnd, Target=dom)  # -> Mapped, Clipped

# ----
# Create circular texture shapes
meshcp = MeshClosestPoint(Point=popgeo, Mesh=mesh_3)  # -> Point, Index, Parameter
meval = MeshEval(Mesh=mesh_3, Parameter=meshcp.Parameter)  # -> Point, Normal, Colour
circle_3 = CircleCNR(Center=popgeo, Normal=meval.Normal, Radius=remap.Mapped)
amp = Amplitude(Vector=meval.Normal, Amplitude=Slider(4, range=0..10))
amp_2 = Amplitude(Vector=meval.Normal, Amplitude=Slider(1, range=0..1))
move = Move(Geometry=circle_3, Motion=amp_2)  # -> Geometry, Transform
boundary_3 = BoundarySurfaces(Edges=move.Geometry)

# ----
# Bake!
# Bake!
# After baking trasform into NURBS
# with MeshToNURBS
# command on Rhino
number_slider_6 = Slider(2, range=0..10)
extr = Extrude(Base=boundary_3, Direction=amp)
offmsh = OffsetMesh(Mesh=mesh_3, Distance=number_slider_6, BothSides=0, CreateSolid=True)
